# Grasshopper definition test0510.gh (Grasshopper 1.0.5)
# plug-ins: Barnacle

# Original Points
point = Point([Point(249, -96, 0), Point(178, -96, 0), Point(178, -31, 0), Point(235, -31, 0)])
point_2 = Point([Point(249, -96, 0), Point(153.7370322, -96, 0), Point(166.3520446, -20.50905132, 0), Point(235, 18.64852257, 0)])
point_3 = Point(point_2)
colour_swatch = ColourSwatch(SwatchColor=RGB(255, 255, 255))
number_slider = Slider(0, range=0..100)
c_script = CSharpScript(switcher=Toggle(True), canvas_back=colour_swatch, canvas_grid=colour_swatch)  # -> out, A
# ---------- c_script: C# ----------
    if ((bool) switcher == true)
    {
      Grasshopper.GUI.Canvas.GH_Skin.canvas_grid = (System.Drawing.Color)canvas_grid;
      Grasshopper.GUI.Canvas.GH_Skin.canvas_back = (System.Drawing.Color)canvas_back;
      Grasshopper.GUI.Canvas.GH_Skin.canvas_edge = Color.FromArgb(255, 0, 0, 0);
      Grasshopper.GUI.Canvas.GH_Skin.canvas_shade = Color.FromArgb(80, 0, 0, 0);
    }
    else
    {
      //DEFAULTS
      Grasshopper.GUI.Canvas.GH_Skin.canvas_grid = Color.FromArgb(30, 0, 0, 0);
      Grasshopper.GUI.Canvas.GH_Skin.canvas_back = Color.FromArgb(255, 212, 208, 200);
      Grasshopper.GUI.Canvas.GH_Skin.canvas_edge = Color.FromArgb(255, 0, 0, 0);
      Grasshopper.GUI.Canvas.GH_Skin.canvas_shade = Color.FromArgb(80, 0, 0, 0);
    }
# ---------- end c_script ----------
value_list = ValueList({"Zero": 0, "One": 1, "Two": 2, "Three": 2² - 1, "Four": Sqrt(16)}, selected="Zero")
polyline = PolyLine(Vertices=point_3, Closed=True)
cluster = Cluster(list=point_3, top_i_result=Slider(0, range=0..1000), get_data=Toggle(True))  # -> result, out, stall_count
panel = Panel(cluster.stall_count)
point_4 = Point()
result_number = Slider(0, range=0..100000)
explode = Explode(Curve=polyline, Recursive=True)  # -> Segments, Vertices
geometry = Geometry(cluster.result)
geometry_2 = Geometry(cluster.out)
geometry_3 = Geometry(geometry_2)
number_slider_2 = Slider(4, range=0..10)
number_slider_3 = Slider(2, range=0..10)
number_slider_4 = Slider(3, range=0..10)
number_slider_5 = Slider(0, range=0..10)
number_slider_6 = Slider(0, range=0..10)
number_slider_7 = Slider(1, range=0..10)
list_length = ListLength(List=geometry_3)
series = Series(Start=0, Step=1, Count=list_length)
list_item = ListItem(List=geometry_3, Index=series, Wrap=True)  # -> Item1, Item
curve_curve = CurveCurve(CurveA=list_item.Item1, CurveB=list_item.Item)  # -> Points, ParamsA, ParamsB
geometry_4 = Geometry(curve_curve.Points)
list_item_2 = ListItem(List=flatten(geometry_4), Index=0, Wrap=True)  # -> Item1, Item, Item1_2, Item2, Item3
point_5 = Point(list_item_2.Item3)
barnacle = Barnacle(
    PointA=list_item_2.Item,
    PointB=list_item_2.Item1_2,
    PointC=list_item_2.Item2,
    PointD=list_item_2.Item3,
    TopIResult=Slider(54, range=0..100),
    GetData=Toggle(True))  # -> Result, Measurement
panel_2 = Panel(barnacle.Measurement)
patch = Patch(Spans=20, Flexibility=1, Trim=True)
curve_self = CurveSelf()  # -> Points, Params
boundary_surfaces = BoundarySurfaces()
list_item_3 = ListItem(Index=0, Wrap=True)
polygon = Polygon(Plane=PlaneXY(0, 0, 0), Radius=3, Segments=6, FilletRadius=0)  # -> Polygon, Length
edge_surface = EdgeSurface()
barnacle_2 = Barnacle()  # -> Result, Measurement

# ==== cluster Cluster
list = ClusterInput()
list_item = ListItem(List=list, Index=0, Wrap=True)  # -> Item, Item1, Item2, Item3
top_i_result = ClusterInput()
get_data = ClusterInput()
boundaryparking = BoundaryParking(
    PointA=list_item.Item,
    PointB=list_item.Item1,
    PointC=list_item.Item2,
    PointD=list_item.Item3,
    TopIResult=top_i_result,
    GetData=get_data)  # -> Result, Out, StallCount
out = ClusterOutput(boundaryparking.Out)
stall_count = ClusterOutput(boundaryparking.StallCount)
result = ClusterOutput(boundaryparking.Result)
